# Grasshopper definition A_star_alg.gh (Grasshopper 1.0.7)
# plug-ins: Bifocals

# ----
# construct the 2d domain (tree structure: 2d matrix)
u_domain = Slider(71, range=0..100)
v_domain = Slider(73, range=0..100)
division = Division(A="1", B=u_domain)
division_2 = Division(A="1", B=v_domain)
dup = DuplicateData(Data=division, Number=u_domain, Order=True)
dup_2 = DuplicateData(Data=division_2, Number=v_domain, Order=True)
merge = Merge(Data1="0", Data2=dup)  # -> flatten(Result)
merge_2 = Merge(Data1="0", Data2=dup_2)  # -> flatten(Result)
consec = ConsecutiveDomains(Numbers=merge_2, Additive=True)  # -> graft(Domains)
consec_2 = ConsecutiveDomains(Numbers=merge, Additive=True)
dom² = ConstructDomain²(DomainU=consec_2, DomainV=consec)

domain² = Domain²(simplify(dom²))
srf = Surface(reparameterize(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))

# ----
# get points matrix (2d)
subsrf = Isotrim(Surface=srf, Domain=domain²)
area = Area(Geometry=subsrf)  # -> Area, Centroid

# ----
# pick start and target point
md_slider = MDSlider(
    SliderMode=0,
    slider_value=Point(0.1365665394, 0.1738925018, 0.5),
    x_domain=Domain(0, 1),
    y_domain=Domain(0, 1),
    z_domain=Domain(0, 1))
md_slider_2 = MDSlider(
    SliderMode=0,
    slider_value=Point(0.3057189185, 0.4144148917, 0.5),
    x_domain=Domain(0, 1),
    y_domain=Domain(0, 1),
    z_domain=Domain(0, 1))
evalsrf = EvaluateSurface(Surface=srf, Point=md_slider)  # -> Point, Normal, UDirection, VDirection, Frame
evalsrf_2 = EvaluateSurface(Surface=srf, Point=md_slider_2)  # -> Point, Normal, UDirection, VDirection, Frame
cp = ClosestPoint(Point=evalsrf_2.Point, Cloud=flatten(area.Centroid))  # -> ClosestPoint, CPIndex, Distance
cp_2 = ClosestPoint(Point=evalsrf.Point, Cloud=flatten(area.Centroid))  # -> ClosestPoint, CPIndex, Distance

# ----
# in
points_nested_list = Point(area.Centroid)
pt = Point(cp_2.ClosestPoint)
target = Point(cp.ClosestPoint)

# ----
# A* script
python = GhPythonScript(pts_matrix=points_nested_list, start_point=pt, target_point=target)  # -> path; inputs pts_matrix: tree of Point3d, start_point: Point3d, target_point: Point3d
# ---------- python: Python ----------
import rhinoscriptsyntax as rs
import Rhino.Geometry as rg
import ghpythonlib.treehelpers as gt
import copy

# I need a tree helper, the gh one does not work well
def my_tree_to_list(tree):
    outer_list = []
    for i in range(tree.BranchCount):
        branchList = tree.Branch(i)
        branchPath = tree.Path(i)
        inner_list = []
        for j in range(tree.Branch(i).Count):
            inner_list.append(tree.Branch(i)[j])
        outer_list.append(inner_list)
    return outer_list

# the most important ingredient of the graph
class node:
    def __init__(self, matrix, index_u, index_v, cost = 1):
        # essential information of myself
        self.point = matrix[index_u][index_v]
        self.u = index_u
        self.v = index_v
        self.cost = cost
        self.neighbours = []
        self.come_from = None
        self.cost_so_far = 0
    
    def calculate_heuristic(self, target_point):
        return self.point.DistanceTo(target_point)
    
    # try to occupy its neighbour and return the successful ones
    def find(self):
        new_list = []
        for neighbour in self.neighbours:
            new_cost = self.cost_so_far + neighbour.cost
            if new_cost < neighbour.cost_so_far or neighbour.come_from == None:
                neighbour.cost_so_far = new_cost
                neighbour.come_from = self
                new_list.append(neighbour)
        return new_list


# graph contains all the nodes, and does all the big behaviors
# it is the main court of the whole game (behaviors) as well
class graph:
    def __init__(self, matrix):
        # copy point matrix first (I want the structure not the content)
        self.matrix = copy.deepcopy(matrix)
        self.frontier = []
        self.current_node = None
        
        # replace my point matrix with a node matrix one by one
        outer_list = []
        for i in range(len(matrix)):
            for j in range(len(matrix[0])):
                self.matrix[i][j] = node(matrix, i, j)
        
        # for each node, find its neighour and store them in the node
        for i in range(len(self.matrix)):
            for j in range(len(self.matrix[0])):
                the_node = self.matrix[i][j]
                # these conditions are to prevent index-out-of-range
                if not i == 0:
                    the_node.neighbours.append(self.matrix[i-1][j])
                if not i == len(self.matrix)-1:
                    the_node.neighbours.append(self.matrix[i+1][j])
                if not j == 0:
                    the_node.neighbours.append(self.matrix[i][j-1])
                if not j == len(self.matrix[0])-1:
                    the_node.neighbours.append(self.matrix[i][j+1])
                    
    # required to pass in a function, which is used for sorting.
    # in this function both cost and heuristc is taken into account
    # to determine the priority
    # in other words, the heuristic is merely used to determine the priority
    def expand_frontier(self, priority_function):
        # delete this node and add new nodes
        self.frontier.remove(self.current_node)
        self.frontier.extend(self.current_node.find())
        # sort the frontier list based on (cost + heuristics)
        self.frontier = sorted(self.frontier, key = priority_function)
        # update the current node
        self.current_node = self.frontier[0]
        
    # play the whole A* searching
    def play(self, start_point, target_point):
        start_node = self.point_find_node(start_point)
        target_node = self.point_find_node(target_point)
        # initialize the game by setting current node and frontier
        # so the game will be: 
        # current node -> search -> refresh frontier -> refresh current node |
        # ^ ------------------ < -------------------- < ----------------------
        self.current_node = start_node
        self.frontier.append(start_node)
        
        while self.frontier and self.current_node.point != target_point:
            self.expand_frontier(lambda x: x.cost_so_far + x.calculate_heuristic(target_point))
        # when the game terminate, hopefully 'current node' holds the target node
        return self.construct_path(start_node, target_node)
        
    # use point to find node, to save time it's badly written
    def point_find_node(self,point):
        for i in range(len(self.matrix)):
            for j in range(len(self.matrix[0])):
                if self.matrix[i][j].point == point:
                    return self.matrix[i][j]

    # construct the path backwords, using a temporal container
    def construct_path(self, start_node, target_node):
        path = []
        
        node_holder = target_node
        path.append(node_holder.point)
        
        while not node_holder == start_node:
            node_holder = node_holder.come_from
            path.append(node_holder.point)
            
        return path



#--------actual code---------------#

pts_matrix = my_tree_to_list(pts_matrix)

the_graph = graph(pts_matrix) 

path = the_graph.play(start_point, target_point)
# ---------- end python ----------

# ----
# out
pt_2 = Point(python)
intcrv_t = InterpolateT(Vertices=pt_2, TangentStart=Vector(0, 0, 0), TangentEnd=Vector(0, 0, 0), KnotStyle=1)  # -> Curve, Length, Domain
