# Grasshopper definition petaloid_structure.gh (Grasshopper 1.0.7)
# plug-ins: Bifocals

pt = Point(Point(8.095940155, 11.16233608, 0))
python = GhPythonScript(
    p=pt,
    r0=Slider(52, range=0..100),
    n=Slider(45, range=0..50),
    layer_num=Slider(17, range=0..50),
    layer_height=Slider(50, range=0..50),
    radius_increment=Slider(34, range=0..100),
    radius_acceleration=Slider(18, range=0..100))  # -> trusses; inputs p: Point3d, n: Int32, layer_num: Int32
# ---------- python: Python ----------
"""
create petaloid structure

Input
p: bottom center point; r0:rinitial radius; n: division;
layer number; layer height; radius increment per layer
Output:
trusses: <rg.polyline> the returned truss

"""

import Rhino.Geometry as rg
import rhinoscriptsyntax as rs
import math
import copy

# stack is the whole structure
class stack:
    def __init__(self, point, radius, n, layer_num, layer_height,radius_increment, raidus_acceleration = 1):
        self.polies = []
        for i in range(layer_num):
            _poly = poly(point+rg.Point3d(0,0,i*layer_height), radius+(i*radius_increment*(1+raidus_acceleration/100)**i),n, i)
            self.polies.append(_poly)
            self.output_lines()
    def output_lines(self):
        self.beams = []
        self.columns = []
        for i,_poly in enumerate(self.polies):
            # first connect itself 
            self.beams.append(_poly.beam)
            if i != (len(self.polies)-1):
                column_pts = []
                for j,p in enumerate(_poly.points):
                    column_pts.append(p)
                    column_pts.append(self.polies[i+1].points[j])
                    if j == len(_poly.points)-1:
                        column_pts.append(_poly.points[0])
                self.columns.append(rg.Polyline(column_pts))
                
# poly is the class containing one-layer information
class poly:
    def __init__(self, p, r, n, rotation):
        self.param = self.get_param_list(n)
        self.param = self.alter_param(self.param, rotation)
        self.circle = rg.Circle(p,r)
        self.points = self.divide_circle(self.circle,self.param)
        end_connected = copy.deepcopy(self.points)
        end_connected.append(end_connected[0])
        self.beam = rg.Polyline(end_connected).ToNurbsCurve()
        
    def get_param_list(self,n):
        new_list = []
        for _ in range(n):
            new_list.append(_*2*math.pi/n)
        return new_list
    def alter_param(self,param,i):
        altered = []
        n = len(param)
        for t in param:
            altered.append((t+(math.pi/n)*i)%(2*math.pi))
        return altered
    def divide_circle(self,circle, param):
        vertices = []
        for t in param:
            vertices.append(circle.PointAt(t))
        return vertices

#------------------- actual code --------------------------#
petaloid = stack(p,r0,n,layer_num, layer_height, radius_increment,radius_acceleration)
trusses = petaloid.columns
# ---------- end python ----------
pipe = Pipe(Curve=python, Radius=Slider(4.295, range=0..10), Caps="2")  # disabled
